# Grasshopper definition from_envelope.gh (Grasshopper 1.0.9)

materialpropertymass = Python3Script(name="Clay Brick")  # -> out, material_property; inputs name: String
# ---------- materialpropertymass: Python ----------
from pod_lca_buildings_tool.material_properties import material_property_mass_from_idf

material_property = material_property_mass_from_idf(name)
# ---------- end materialpropertymass ----------
panel = Panel(materialpropertymass.material_property)
