# Grasshopper definition parametric_lca.gh (Grasshopper 1.0.9)

quantity = Python3Script(value=Slider(0.1, range=0..1), unit="W/m*K")  # -> out, quantity; inputs unit: String
# ---------- quantity: Python ----------
from pod_lca_buildings_tool.units import quantity_from_value_unit

quantity = quantity_from_value_unit(value, unit)
# ---------- end quantity ----------
quantity_2 = Python3Script(value=Slider(0.5, range=0..10), unit="m")  # -> out, quantity; inputs unit: String; same code as quantity
materialpropertymass_fromidf = Python3Script(name="Mineral wool blanket baseline")  # -> out, material_property; inputs name: String
# ---------- materialpropertymass_fromidf: Python ----------
from pod_lca_buildings_tool.material_properties import material_property_mass_from_idf

material_property = material_property_mass_from_idf(name)
# ---------- end materialpropertymass_fromidf ----------
materialpropertymass_fromidf_2 = Python3Script(name="Gypsum board")  # -> out, material_property; inputs name: String; same code as materialpropertymass_fromidf
materialpropertymass_fromidf_3 = Python3Script(name="Gypsum board")  # -> out, material_property; inputs name: String; same code as materialpropertymass_fromidf
materialpropertymass_fromidf_4 = Python3Script(name="Clay Brick")  # -> out, material_property; inputs name: String; same code as materialpropertymass_fromidf
materialpropertyairgap_fromidf = Python3Script(name="Generic Wall Air Gap")  # -> out, material_property; inputs name: String
# ---------- materialpropertyairgap_fromidf: Python ----------
from pod_lca_buildings_tool.material_properties import material_property_air_gap_from_idf

material_property = material_property_air_gap_from_idf(name)
# ---------- end materialpropertyairgap_fromidf ----------
materialpropertynomass = Python3Script(
    name="Expanded polystyrene (EPS) Type 1",
    conductivity=quantity.quantity,
    thickness=quantity_2.quantity,
    roughness="MediumRough")  # -> out, material_property; inputs name: String
# ---------- materialpropertynomass: Python ----------
from pod_lca_buildings_tool.material_properties import material_property_no_mass

material_property = material_property_no_mass(name,
                                              conductivity,
                                              thickness,
                                              roughness,
                                              thermal_absorptance=.9,
                                              solar_absorptance=.7, 
                                              visible_absorptance=.7)
# ---------- end materialpropertynomass ----------
materialpropertymass_fromidf_5 = Python3Script(name="Softwood Lumber")  # -> out, material_property; inputs name: String; same code as materialpropertymass_fromidf
quantity_3 = Python3Script(value=Slider(2, range=0..10), unit="in")  # -> out, quantity; inputs unit: String; same code as quantity
quantity_4 = Python3Script(value=Slider(0.5, range=0..1), unit="in")  # -> out, quantity; inputs unit: String; same code as quantity
quantity_5 = Python3Script(value=Slider(0.5, range=0..1), unit="in")  # -> out, quantity; inputs unit: String; same code as quantity
quantity_6 = Python3Script(value=Slider(12, range=0..100), unit="in")  # -> out, quantity; inputs unit: String; same code as quantity
quantity_7 = Python3Script(value=Slider(3.5, range=0..10), unit="in")  # -> out, quantity; inputs unit: String; same code as quantity
quantity_8 = Python3Script(value=Slider(1.5, range=0..10), unit="in")  # -> out, quantity; inputs unit: String; same code as quantity
quantity_9 = Python3Script(value=Slider(1.5, range=0..10), unit="in")  # -> out, quantity; inputs unit: String; same code as quantity
quantity_10 = Python3Script(value=Slider(0.75, range=0..1), unit="in")  # -> out, quantity; inputs unit: String; same code as quantity
quantity_11 = Python3Script(value=Slider(1.5, range=0..10), unit="in")  # -> out, quantity; inputs unit: String; same code as quantity
layer = Python3Script(
    name="Mineral wool blanket baseline",
    material_property=materialpropertymass_fromidf.material_property,
    thickness=quantity_3.quantity,
    classification="framing_insulation")  # -> out, layer
# ---------- layer: Python ----------
from pod_lca_buildings_tool.layers import layer_from_material_property_and_thickness

layer = layer_from_material_property_and_thickness(name,
                                                   material_property,
                                                   thickness,
                                                   classification)
# ---------- end layer ----------
layer_2 = Python3Script(
    name="Gypsum board",
    material_property=materialpropertymass_fromidf_2.material_property,
    thickness=quantity_4.quantity,
    classification="interior_finish")  # -> out, layer; same code as layer
layer_3 = Python3Script(
    name="Gypsum board",
    material_property=materialpropertymass_fromidf_3.material_property,
    thickness=quantity_5.quantity,
    classification="sheathing")  # -> out, layer; same code as layer
layer_4 = Python3Script(
    name="Clay Brick",
    material_property=materialpropertymass_fromidf_4.material_property,
    thickness=quantity_10.quantity,
    classification="exterior_cladding")  # -> out, layer; same code as layer
layer_5 = Python3Script(
    name="Generic Wall Air Gap",
    material_property=materialpropertyairgap_fromidf.material_property,
    thickness=quantity_9.quantity,
    classification="air_gap")  # -> out, layer; same code as layer
layer_6 = Python3Script(
    name="Expanded polystyrene (EPS) Type 1",
    material_property=materialpropertynomass.material_property,
    thickness=quantity_11.quantity,
    classification="exterior_insulation")  # -> out, layer; same code as layer
woodframing = Python3Script(
    name="Timber Framing",
    material_property=materialpropertymass_fromidf_5.material_property,
    spacing=quantity_6.quantity,
    width=quantity_8.quantity,
    length=quantity_7.quantity)  # -> out, framing
# ---------- woodframing: Python ----------
from pod_lca_buildings_tool.framings import wooden_framing_from_parameters

framing = wooden_framing_from_parameters(name,
                                         material_property,
                                         spacing,
                                         width,
                                         length)
# ---------- end woodframing ----------
quantity_12 = Python3Script(value=Slider(2, range=0..10), unit="m")  # -> out, quantity; inputs unit: String; same code as quantity
quantity_13 = Python3Script(value=Slider(3, range=0..10), unit="m")  # -> out, quantity; inputs unit: String; same code as quantity
framedwall = Python3Script(
    name="Framed wall tomas",
    layers=[layer_4.layer, layer_5.layer, layer_6.layer, layer_3.layer, layer.layer, layer_2.layer],
    framing=woodframing.framing)  # -> out, framed_wall; inputs layers: list
# ---------- framedwall: Python ----------
from pod_lca_buildings_tool.walls import framed_wall_from_layers_and_framing


framed_wall = framed_wall_from_layers_and_framing(name, layers, framing)
# ---------- end framedwall ----------
windows_from_idf_dimensions = Python3Script(name="Generic Double Pane", wwr=Slider(0.9, range=0..1))  # -> out, window
# ---------- windows_from_idf_dimensions: Python ----------
from pod_lca_buildings_tool.windows import window_from_idf_and_wwr

window = window_from_idf_and_wwr(name, wwr)
# ---------- end windows_from_idf_dimensions ----------
windows_from_idf_dimensions_2 = Python3Script(name="Generic Double Pane", width=quantity_13.quantity, length=quantity_12.quantity)  # -> out, window
# ---------- windows_from_idf_dimensions_2: Python ----------
from pod_lca_buildings_tool.windows import window_from_idf_and_dimensions

window = window_from_idf_and_dimensions(name, width, length)
# ---------- end windows_from_idf_dimensions_2 ----------
floor_from_idf = Python3Script(name="Generic Interior Floor")  # -> out, floor
# ---------- floor_from_idf: Python ----------
from pod_lca_buildings_tool.floors import floor_from_idf

floor = floor_from_idf(name)
# ---------- end floor_from_idf ----------
ceiling_from_idf = Python3Script(name="Generic Interior Ceiling")  # -> out, ceiling
# ---------- ceiling_from_idf: Python ----------
from pod_lca_buildings_tool.ceilings import ceiling_from_idf

ceiling = ceiling_from_idf(name)
# ---------- end ceiling_from_idf ----------
number_slider = Slider(8, range=0..10)
polyline = Python3Script()  # -> out, pl
# ---------- polyline: Python ----------
import rhinoscriptsyntax as rs
x = 20
y = 50
zero = 0

floor_plan = [[zero,zero,zero],
              [zero,y,zero], 
              [x/2, y+(y/4),zero],
              [x,y,zero],
              [x,zero,zero],
              [x/2, -y/4,zero],
              [zero, zero, zero]]

pl = rs.AddPolyline(floor_plan)
# ---------- end polyline ----------
quantity_14 = Python3Script(value=Slider(3, range=0..10), unit="m")  # -> out, quantity; inputs unit: String; same code as quantity
floor_plan_from_polyline = Python3Script(polyline=polyline.pl, floor_to_floor=quantity_14.quantity, building_type="Residential")  # -> out, floor_plan
# ---------- floor_plan_from_polyline: Python ----------
from pod_lca_buildings_tool.floor_plans import floor_plan_from_polyline


floor_plan = floor_plan_from_polyline(polyline,
                                      floor_to_floor,
                                      building_type)
# ---------- end floor_plan_from_polyline ----------
panel = Panel("""wall_1
wall_2""")
envelope_from_components = Python3Script(
    name="envelope_here",
    floor_plan=floor_plan_from_polyline.floor_plan,
    wall=framedwall.framed_wall,
    floor=floor_from_idf.floor,
    ceiling=ceiling_from_idf.ceiling,
    windows=[windows_from_idf_dimensions_2.window, windows_from_idf_dimensions.window],
    window_wall_keys=panel)  # -> out, env; inputs windows: list, window_wall_keys: list
# ---------- envelope_from_components: Python ----------
from pod_lca_buildings_tool.envelopes import envelope_from_components

env = envelope_from_components(name, 
                               floor_plan,
                               wall=wall,
                               floor=floor,
                               ceiling=ceiling,
                               windows=windows,
                               window_wall_keys=window_wall_keys)
# ---------- end envelope_from_components ----------
building_envelope = Python3Script(envelope=envelope_from_components.env, num_stories=number_slider)  # -> out, building_envelope; inputs num_stories: Int32
# ---------- building_envelope: Python ----------
from pod_lca_buildings_tool.building_envelopes import envelope_from_components

building_envelope = envelope_from_components(envelope,
                                             num_stories)
# ---------- end building_envelope ----------
statistical_structure = Python3Script(floor_plan=floor_plan_from_polyline.floor_plan, structure_type="Concrete", mui_type="low", num_stories=number_slider)  # -> out, structure
# ---------- statistical_structure: Python ----------
from pod_lca_buildings_tool.structures import statistical_structure_from_floor_plan


structure = statistical_structure_from_floor_plan(floor_plan,
                                                  structure_type,
                                                  mui_type,
                                                  num_stories)
# ---------- end statistical_structure ----------
location = Python3Script(location="98126, Seattle")  # -> out, location; inputs location: String
# ---------- location: Python ----------
import ssl, certifi
import geopy.geocoders

ctx = ssl.create_default_context(cafile=certifi.where())
geopy.geocoders.options.default_ssl_context = ctx


from pod_lca_buildings_tool.location import location_from_string

location = location_from_string(location)
# ---------- end location ----------
panel_2 = Panel(location.location)
building_from_assemblies = Python3Script(
    name="Tomas Building",
    location=location.location,
    built_year=Slider(2025, range=0..10000),
    life_span=Slider(100, range=0..100),
    structure=statistical_structure.structure,
    building_envelope=building_envelope.building_envelope)  # -> out, building
# ---------- building_from_assemblies: Python ----------
from pod_lca_buildings_tool.buildings import building_from_assemblies

building = building_from_assemblies(name,
                                    location,
                                    built_year,
                                    life_span,
                                    structure,
                                    building_envelope)
# ---------- end building_from_assemblies ----------
panel_3 = Panel("/Users/time/Documents/UW/04_code/pod_lca/pod_lca/temp/out/tomas.idf")
panel_4 = Panel("/Users/time/Documents/UW/04_code/pod_lca/pod_lca/temp/EnergyPlus-25-1-0")
run_operational = Python3Script(
    building=building_from_assemblies.building,
    eplus_path=panel_4,
    eplus_output_path="/Users/time/Documents/UW/04_code/pod_lca/pod_lca/temp/out",
    idf_path=panel_3,
    run=Toggle(False))  # -> out, op
# ---------- run_operational: Python ----------
from pod_lca_buildings_tool.operational import run_operational


print(building.get_operational_impacts())

# if run:
#     op = run_operational(building,
#                         operational_method='eplus',
#                         eplus_path=eplus_path,
#                         eplus_output_path=eplus_output_path,
#                         idf_path=idf_path,
#                         weather_file_path=weather_file_path,
#                         )
# ---------- end run_operational ----------
run_embodied = Python3Script(building=building_from_assemblies.building, run=Toggle(False))  # -> out
# ---------- run_embodied: Python ----------
from pod_lca_buildings_tool.embodied import run_embodied

# em = run_embodied(building)
# print(em)

if run:
  print(building.get_impacts(scope='product'))
# ---------- end run_embodied ----------
panel_5 = Panel(run_embodied)
panel_6 = Panel(run_operational.out)
